# Grasshopper definition PS_Clustering_PtCloud.gh (Grasshopper 1.0.7)
# plug-ins: LunchBoxML, Dodo

number_slider = Slider(100, range=0..100)
random = Random(Range=Domain(0, 1), Number=number_slider, Seed=3)
# Point Clustering Problem with k-means clustering and gaussian mixture
# Inputs (x,y,z) values of points. At each set there is three elements
# Output cluster IDs
# 
# Play with number of clusters and gradient graphs for sphere visualization
# 
# Observe how points are connected with proximity
# Observe how points for 3D Convex Hull
random_2 = Random(Range=Domain(0, 1), Number=number_slider, Seed=2)
random_3 = Random(Range=Domain(0, 1), Number=number_slider, Seed=7)
pt = ConstructPoint(XCoordinate=random_2, YCoordinate=random, ZCoordinate=random_3)
entwine = Entwine(Branch00=random_2, Branch01=random, Branch02=random_3, FlattenInputs=True)
number_slider_2 = Slider(3, range=0..10)
flip = FlipMatrix(Data=entwine)
sph = Sphere(Base=pt, Radius=Slider(0.05, range=0..0.1))
gaussianmix = GaussianMixture(TrainingInputs=flip, Components=number_slider_2, RandomSeed=5)  # -> Result, Likelihood, Probability
k_means = KMeansClustering(TrainingInputs=flip, OfClusters=number_slider_2, RandomSeed=5)  # -> Result, Likelihood, Centroids
series = Series(Start=0, Step=1, Count=number_slider_2)
eval = Evaluate(F="if(x=y,1,0)", x=k_means.Result, y=graft(series))
bnd = Bounds(Numbers=k_means.Result)
eval_2 = Evaluate(F="if(x=y,1,0)", x=gaussianmix.Result, y=graft(series))
bnd_2 = Bounds(Numbers=gaussianmix.Result)
dedomain = DeconstructDomain(Domain=bnd)  # -> Start, End
cull = CullPattern(List=pt, CullPattern=eval)
dedomain_2 = DeconstructDomain(Domain=bnd_2)  # -> Start, End
cull_2 = CullPattern(List=pt, CullPattern=eval_2)
gradient = Gradient(
    LowerLimit=dedomain_2.Start,
    UpperLimit=dedomain_2.End,
    Parameter=gaussianmix.Result,
    stops=[0: RGB(0, 128, 0), 0.5: RGB(255, 255, 0), 1: RGB(255, 0, 0)])
gradient_2 = Gradient(
    LowerLimit=dedomain.Start,
    UpperLimit=dedomain.End,
    Parameter=k_means.Result,
    stops=[0: RGB(0, 128, 0), 0.5: RGB(255, 255, 0), 1: RGB(255, 0, 0)])
panel = Panel(gaussianmix.Likelihood)
panel_2 = Panel(k_means.Likelihood)
preview = CustomPreview(Geometry=sph, Material=gradient)
prox = Proximity3D(Points=cull_2, Group=Slider(20, range=0..100))  # -> Links, Topology
convexhull3d = ConvexHull3D(Points=cull_2)
preview_2 = CustomPreview(Geometry=sph, Material=gradient_2)
prox_2 = Proximity3D(Points=cull, Group=Slider(20, range=0..100))  # -> Links, Topology
convexhull3d_2 = ConvexHull3D(Points=cull)
