# Grasshopper definition PS_NonLinearRegression_SurfaceControlPts.gh (Grasshopper 1.0.7)
# plug-ins: LunchBoxML

pt = Point([<point referenced from the Rhino model> x34])
pdecon = Deconstruct(Point=pt)  # -> XComponent, YComponent, ZComponent
number_slider = Slider(20, range=0..100)
bnd = Bounds(Numbers=pdecon.YComponent)
entwine = Entwine(Branch00=pdecon.XComponent, Branch01=pdecon.YComponent, FlattenInputs=True)
# Construct a surface approximation with respect to points
# Handle problem as a nonlinear regression problem
# Inputs x,y coordindates, Output z coordinates
# Apply to a grid to obtain the surface with Surface From Points component.
# 
# The input points act like control points
# Play with the points in rhino to observe the effect
# Play with Sigma value and observe surface behaviour
# Also observe mean distance of input points to output surface
bnd_2 = Bounds(Numbers=pdecon.XComponent)
flip = FlipMatrix(Data=entwine)
range = Range(Domain=bnd_2, Steps=number_slider)
range_2 = Range(Domain=bnd, Steps=number_slider)
sigma = Slider(3.422, range=0..50)
crossref = CrossReference(ListA=range, ListB=range_2, CrossMode=1)  # -> ListA, ListB
entwine_2 = Entwine(Branch00=crossref.ListA, Branch01=crossref.ListB, FlattenInputs=True)
flip_2 = FlipMatrix(Data=entwine_2)
nonlinereg = NonlinearRegression(TestData=flip_2, Inputs=flip, Output=pdecon.ZComponent, Degree=sigma, Complexity=Slider(100, range=0..100), RandomSeed=5)  # -> Result, Score, Error
pt_2 = ConstructPoint(XCoordinate=crossref.ListA, YCoordinate=crossref.ListB, ZCoordinate=flatten(nonlinereg.Result))
srfgrid = SurfaceFromPoints(Points=pt_2, UCount=expr("x+1", number_slider), Interpolate=False)
srf_cp = SurfaceClosestPoint(Point=pt, Surface=srfgrid)  # -> Point, UVPoint, Distance
avr = Average(Input=srf_cp.Distance)
panel = Panel(avr)
