# Grasshopper definition PS1_Clustering_PtCloud.gh (Grasshopper 1.0.6)
# plug-ins: MeshEdit Components, LunchBoxML

# ----
# Generate Random Points by random numbers
# [notice that seeds are different]
number_of_points = Slider(100, range=0..100)
random = Random(Range=Domain(0, 1), Number=number_of_points, Seed="3")
random_2 = Random(Range=Domain(0, 1), Number=number_of_points, Seed="2")
random_3 = Random(Range=Domain(0, 1), Number=number_of_points, Seed="7")
pt = ConstructPoint(XCoordinate=random_2, YCoordinate=random, ZCoordinate=random_3)
sph = Sphere(Base=pt, Radius=Slider(0.05, range=0..0.1))

number_of_clusters = Slider(5, range=0..10)

# ----
# Gaussian Mixture
# Considers covariance
# Not necessarily spherical
# k-Means
# selects most importan point as centroid
# draws a sphere to form the cluster
# Point Clustering Problem with k-means clustering and gaussian mixture
# Inputs (x,y,z) values of points. At each set there is three elements
# Output cluster IDs
# 
# Play with number of clusters and gradient graphs for sphere visualization
# 
# Observe how points are connected with proximity
# Observe how points for 3D Convex Hull
image = ImageSampler(
    FilePath="C:\Users\firat\Desktop\MLArch-master\kmeans.png",
    Filter="Colour",
    Interpolate=False,
    Umax=479,
    Umin=1,
    Vmax=341,
    Vmin=1,
    Wrap=1)
image_2 = ImageSampler(
    FilePath="C:\Users\firat\Desktop\MLArch-master\gaussianMixture.png",
    Filter="Colour",
    Interpolate=False,
    Umax=479,
    Umin=1,
    Vmax=341,
    Vmin=1,
    Wrap=1)

# ----
# Prepare data for training
entwine = Entwine(Branch00=random_2, Branch01=random, Branch02=random_3, FlattenInputs=True)
flip = FlipMatrix(Data=entwine)

# ----
# Case 1: K-Means Clustering
# Observe outputs [likelihood]
# 
# Get training result
# Separate points to different sets
k_means = KMeansClustering(TrainingInputs=flip, OfClusters=number_of_clusters, RandomSeed=5)  # -> Result, Likelihood, Centroids
series = Series(Start=0, Step=1, Count=number_of_clusters)
eval = Evaluate(F="if(x=y,1,0)", x=k_means.Result, y=graft(series))
cull = CullPattern(List=pt, CullPattern=eval)

# ----
# Case 2: Gaussian Mixture
# Observe outputs [likelihood]
# 
# Get training result
# Separate points to different sets
gaussianmix = GaussianMixture(TrainingInputs=flip, Components=number_of_clusters, RandomSeed=5)  # -> Result, Likelihood, Probability
eval_2 = Evaluate(F="if(x=y,1,0)", x=gaussianmix.Result, y=graft(series))
cull_2 = CullPattern(List=pt, CullPattern=eval_2)

# ----
# Generate colors with respect to number of clusters and visualize
# Draw lines between cluster points
# Construct 3D Convex Hull [requires Dodo]
range = Range(Domain=Domain(0, 0.9), Steps=expr("x-1", number_of_clusters))
hsv = ColourHSV(Alpha=1, Hue=range, Saturation=1, Value=1)
convexhull = _3DConvexHull(Points=cull_2)
item = ListItem(List=hsv, Index=gaussianmix.Result, Wrap=True)
del3d = _3DDelaunay(Points=cull_2)  # -> TopologicalEdges, Connectivity
preview = CustomPreview(Geometry=sph, Material=item)
preview_2 = CustomPreview(Geometry=del3d.TopologicalEdges, Material=graft(hsv))
preview_3 = CustomPreview(Geometry=convexhull, Material=graft(hsv))

# ----
# Likelihood Values
# K-means | Gaussian Mixture
# Prediction Results
# K-means | Gaussian Mixture
panel = Panel(k_means.Likelihood)
panel_2 = Panel(gaussianmix.Likelihood)
panel_3 = Panel(k_means.Result)
equals = Equality(FirstNumber=k_means.Result, SecondNumber=gaussianmix.Result)  # -> Equality, Inequality
dispatch = Dispatch(List=equals.Equality, DispatchPattern=equals.Equality)  # -> ListA, ListB
panel_4 = Panel(gaussianmix.Result)
lng = ListLength(List=dispatch.ListA)
lng_2 = ListLength(List=dispatch.ListB)

# ----
# Generate colors with respect to number of clusters and visualize
# Draw lines between cluster points
# Construct 3D Convex Hull [requires Dodo]
range_2 = Range(Domain=Domain(0, 0.9), Steps=expr("x-1", number_of_clusters))
hsv_2 = ColourHSV(Alpha=1, Hue=range_2, Saturation=1, Value=1)
convexhull_2 = _3DConvexHull(Points=cull)
item_2 = ListItem(List=hsv_2, Index=k_means.Result, Wrap=True)
del3d_2 = _3DDelaunay(Points=cull)  # -> TopologicalEdges, Connectivity
preview_4 = CustomPreview(Geometry=sph, Material=item_2)
preview_5 = CustomPreview(Geometry=del3d_2.TopologicalEdges, Material=graft(hsv_2))
preview_6 = CustomPreview(Geometry=convexhull_2, Material=graft(hsv_2))
