# Grasshopper definition PS3_classification_ANN.gh (Grasshopper 1.0.6)
# plug-ins: LunchBoxML

trainingset = TrainingSet()  # -> simplify(L_3), simplify(L_2), simplify(L_4), simplify(L)

# ----
# Observe Data
panel = Panel(trainingset.L_3)

# ----
# Visualize Training Data
number_slider = Slider(5000, range=0..10000)
tstat = TreeStatistics(Tree=trainingset.L_3)  # -> Paths, Length, Count
flip = FlipMatrix(Data=trainingset.L_3)
tstat_2 = TreeStatistics(Tree=trainingset.L_2)  # -> Paths, Length, Count
flip_2 = FlipMatrix(Data=trainingset.L_2)
number_slider_2 = Slider(5000, range=0..10000)
number_slider_3 = Slider(5000, range=0..10000)
tstat_3 = TreeStatistics(Tree=trainingset.L_4)  # -> Paths, Length, Count
tstat_4 = TreeStatistics(Tree=trainingset.L)  # -> Paths, Length, Count
flip_3 = FlipMatrix(Data=trainingset.L_4)
flip_4 = FlipMatrix(Data=trainingset.L)
lng = ListLength(List=flatten(tstat.Paths))
bang = ExplodeTree(Data=flip)  # -> Branch0, Branch1, Branch2, Branch3
lng_2 = ListLength(List=flatten(tstat_2.Paths))
bang_2 = ExplodeTree(Data=flip_2)  # -> Branch0, Branch1, Branch2, Branch3
lng_3 = ListLength(List=flatten(tstat_3.Paths))
bang_3 = ExplodeTree(Data=flip_3)  # -> Branch0, Branch1, Branch2, Branch3
lng_4 = ListLength(List=flatten(tstat_4.Paths))
bang_4 = ExplodeTree(Data=flip_4)  # -> Branch0, Branch1, Branch2, Branch3
series = Series(Start=0, Step=Slider(1000, range=0..1000), Count=lng)
series_2 = Series(Start=0, Step=number_slider_2, Count=lng_2)
series_3 = Series(Start=0, Step=number_slider_3, Count=lng_3)
series_4 = Series(Start=0, Step=number_slider, Count=lng_4)
pt = ConstructPoint(XCoordinate=series_2, YCoordinate=expr("10*x", number_slider_2), ZCoordinate=0)
pt_2 = ConstructPoint(XCoordinate=series, YCoordinate=0, ZCoordinate=0)
pt_3 = ConstructPoint(XCoordinate=series_3, YCoordinate=expr("20*x", number_slider_3), ZCoordinate=0)
pt_4 = ConstructPoint(XCoordinate=series_4, YCoordinate=expr("30*x", number_slider), ZCoordinate=0)
box = CenterBox(Base=flatten(pt_2), X=bang.Branch0, Y=bang.Branch1, Z=bang.Branch2)
box_2 = CenterBox(Base=flatten(pt), X=bang_2.Branch0, Y=bang_2.Branch1, Z=bang_2.Branch2)
box_3 = CenterBox(Base=flatten(pt_3), X=bang_3.Branch0, Y=bang_3.Branch1, Z=bang_3.Branch2)
box_4 = CenterBox(Base=flatten(pt_4), X=bang_4.Branch0, Y=bang_4.Branch1, Z=bang_4.Branch2)
merge = Merge(Data1=box, Data2=box_2, Data3=box_3, Data4=box_4)
merge_2 = Merge(Data1=bang.Branch3, Data2=bang_2.Branch3, Data3=bang_3.Branch3, Data4=bang_4.Branch3)
eval = Evaluate(F="if(x=\"column\", 0, if(x=\"beam\",1, if(x=\"wall\", 2, 3)))", x=merge_2)
p_n_c = PickNChoose(
    Pattern=graft(eval),
    Stream0=ColourSwatch(SwatchColor=RGB(0, 0, 255)),
    Stream1=ColourSwatch(SwatchColor=RGB(0, 255, 0)),
    Stream2=ColourSwatch(SwatchColor=RGB(255, 0, 0)),
    Stream3=ColourSwatch(SwatchColor=RGB(120, 128, 126)))
preview = CustomPreview(Geometry=graft(merge), Material=p_n_c)

# ----
# Prepare training data
# Convert text labels to integers
flip_5 = FlipMatrix(Data=trainingset.L_3)
flip_6 = FlipMatrix(Data=trainingset.L_2)
flip_7 = FlipMatrix(Data=trainingset.L_4)
flip_8 = FlipMatrix(Data=trainingset.L)
merge_3 = Merge(Data1=flip_5, Data2=flip_6, Data3=flip_7, Data4=flip_8)
jitter = Jitter(List=merge_3, Jitter=1, Seed=2)  # -> Values, Indices
bang_5 = ExplodeTree(Data=jitter.Values)  # -> Branch0, Branch1, Branch2, Branch3
entwine = Entwine(Branch00=bang_5.Branch0, Branch01=bang_5.Branch1, Branch02=bang_5.Branch2, FlattenInputs=True)
eval_2 = Evaluate(F="if(x=\"column\", 0, if(x=\"beam\",1, if(x=\"wall\", 2, 3)))", x=bang_5.Branch3)
flip_9 = FlipMatrix(Data=entwine)

# ----
# Import test geometry and prepare test data
brep = Brep([<brep referenced from the Rhino model> x4605])
debox = DeconstructBox(Box=brep)  # -> Plane, graft(X), graft(Y), graft(Z)
dedomain = DeconstructDomain(Domain=debox.Z)  # -> Start, End
dedomain_2 = DeconstructDomain(Domain=debox.Y)  # -> Start, End
dedomain_3 = DeconstructDomain(Domain=debox.X)  # -> Start, End
subtraction = Subtraction(A=dedomain.End, B=dedomain.Start)
subtraction_2 = Subtraction(A=dedomain_2.End, B=dedomain_2.Start)
subtraction_3 = Subtraction(A=dedomain_3.End, B=dedomain_3.Start)
merge_4 = Merge(Data1=subtraction_3, Data2=subtraction_2, Data3=subtraction)  # -> simplify(Result)

partition = PartitionList(List=brep, Size=Slider(600, range=0..1000))

# ----
# same seed same shuffling illustration
panel_2 = Panel("""a
b
c
d""")
panel_3 = Panel("""0
1
2
3""")
jitter_2 = Jitter(List=panel_2, Jitter=1, Seed=2)  # -> Values, Indices
jitter_3 = Jitter(List=panel_3, Jitter=1, Seed=2)  # -> Values, Indices
panel_4 = Panel(jitter_2.Values)
panel_5 = Panel(jitter_3.Values)

bang_6 = ExplodeTree(Data=partition)  # -> Branch0, Branch1, Branch2, Branch3, Branch4, Branch5, Branch6, Branch7
panel_6 = Panel(merge_4)

# ----
# Case 3: Normalize training data and test data with their own bounds
# Observe results
# 
# Note: Data is liberated from dimensions,
# Ratios are trained
bnd = Bounds(Numbers=flip_9)
bnd_2 = Bounds(Numbers=merge_4)
remap = RemapNumbers(Value=flip_9, Source=bnd, Target=Domain(0, 1))  # -> Mapped, Clipped
remap_2 = RemapNumbers(Value=merge_4, Source=bnd_2, Target=Domain(0, 1))  # -> simplify(Mapped), Clipped
neural = NeuralNetwork(
    TestData=remap_2.Mapped,
    TraingInputs=remap.Mapped,
    Labels=flatten(eval_2),
    HiddenNeurons=5,
    Alpha=2,
    Iterations=10,
    RandomSeed=5)
p_n_c_2 = PickNChoose(
    Pattern=graft(neural),
    Stream0=ColourSwatch(SwatchColor=RGB(0, 0, 255)),
    Stream1=ColourSwatch(SwatchColor=RGB(0, 255, 0)),
    Stream2=ColourSwatch(SwatchColor=RGB(255, 0, 0)),
    Stream3=ColourSwatch(SwatchColor=RGB(120, 128, 126)))
preview_2 = CustomPreview(Geometry=graft(brep), Material=simplify(p_n_c_2))

# ----
# Case 2: Normalize training data [0:1]
# Scale test data with the same factor
# Observe test results
bnd_3 = Bounds(Numbers=flatten(flip_9))
remap_3 = RemapNumbers(Value=merge_4, Source=bnd_3, Target=Domain(0, 1))  # -> Mapped, Clipped
remap_4 = RemapNumbers(Value=flip_9, Source=bnd_3, Target=Domain(0, 1))  # -> Mapped, Clipped
neural_2 = NeuralNetwork(
    TestData=remap_3.Mapped,
    TraingInputs=remap_4.Mapped,
    Labels=flatten(eval_2),
    HiddenNeurons=5,
    Alpha=2,
    Iterations=10,
    RandomSeed=5)
p_n_c_3 = PickNChoose(
    Pattern=graft(neural_2),
    Stream0=ColourSwatch(SwatchColor=RGB(0, 0, 255)),
    Stream1=ColourSwatch(SwatchColor=RGB(0, 255, 0)),
    Stream2=ColourSwatch(SwatchColor=RGB(255, 0, 0)),
    Stream3=ColourSwatch(SwatchColor=RGB(120, 128, 126)))
preview_3 = CustomPreview(Geometry=graft(brep), Material=simplify(p_n_c_3))

# ----
# Case 1: Give Input without data normalization
# Observe test results
neural_3 = NeuralNetwork(TestData=merge_4, TraingInputs=flip_9, Labels=flatten(eval_2), HiddenNeurons=5, Alpha=2, Iterations=10, RandomSeed=5)
p_n_c_4 = PickNChoose(
    Pattern=graft(neural_3),
    Stream0=ColourSwatch(SwatchColor=RGB(0, 0, 255)),
    Stream1=ColourSwatch(SwatchColor=RGB(0, 255, 0)),
    Stream2=ColourSwatch(SwatchColor=RGB(255, 0, 0)),
    Stream3=ColourSwatch(SwatchColor=RGB(120, 128, 126)))
preview_4 = CustomPreview(Geometry=graft(brep), Material=simplify(p_n_c_4))

panel_7 = Panel(neural_3)

# ==== cluster TrainingSet

dom = ConstructDomain(DomainStart=Slider(40, range=0..100), DomainEnd=Slider(80, range=0..1000))
dom_2 = ConstructDomain(DomainStart=Slider(250, range=0..1000), DomainEnd=Slider(1000, range=0..1000))
dom_3 = ConstructDomain(DomainStart=Slider(20, range=0..100), DomainEnd=Slider(50, range=0..100))
random = Random(Range=dom_3, Number=Slider(100, range=0..100), Seed=Slider(5, range=0..10))
random_2 = Random(Range=dom_2, Number=Slider(100, range=0..100), Seed=2)
random_3 = Random(Range=dom, Number=Slider(100, range=0..100), Seed=2)
box = CenterBox(Base=PlaneXY(0, 0, 0), X=random, Y=random_2, Z=random_3)

dom_4 = ConstructDomain(DomainStart=Slider(40, range=0..100), DomainEnd=Slider(80, range=0..1000))
dom_5 = ConstructDomain(DomainStart=Slider(250, range=0..1000), DomainEnd=Slider(1000, range=0..1000))
dom_6 = ConstructDomain(DomainStart=Slider(20, range=0..100), DomainEnd=Slider(50, range=0..100))
random_4 = Random(Range=dom_6, Number=Slider(100, range=0..100), Seed=Slider(5, range=0..10))
random_5 = Random(Range=dom_5, Number=Slider(100, range=0..100), Seed=2)
random_6 = Random(Range=dom_4, Number=Slider(100, range=0..100), Seed=2)
box_2 = CenterBox(Base=PlaneXY(0, 0, 0), X=random_5, Y=random_4, Z=random_6)

dom_7 = ConstructDomain(DomainStart=Slider(500, range=0..1000), DomainEnd=Slider(1000, range=0..1000))
dom_8 = ConstructDomain(DomainStart=Slider(10, range=0..100), DomainEnd=Slider(30, range=0..100))
dom_9 = ConstructDomain(DomainStart=Slider(250, range=0..1000), DomainEnd=Slider(600, range=0..1000))
random_7 = Random(Range=dom_8, Number=Slider(100, range=0..100), Seed=5)
random_8 = Random(Range=dom_7, Number=Slider(100, range=0..100), Seed=1)
random_9 = Random(Range=dom_9, Number=Slider(100, range=0..100), Seed=2)
wall = CenterBox(Base=PlaneXY(0, 0, 0), X=random_7, Y=random_8, Z=random_9)

dom_10 = ConstructDomain(DomainStart=Slider(10, range=0..100), DomainEnd=Slider(30, range=0..100))
random_10 = Random(Range=dom_10, Number=Slider(100, range=0..100), Seed=2)
dom_11 = ConstructDomain(DomainStart=Slider(250, range=0..1000), DomainEnd=Slider(1000, range=0..1000))
random_11 = Random(Range=dom_11, Number=Slider(100, range=0..100), Seed=5)
jitter = Jitter(List=random_11, Jitter=Slider(1, range=0..1), Seed=2)  # -> Values, Indices

dom_12 = ConstructDomain(DomainStart=Slider(20, range=0..100), DomainEnd=Slider(50, range=0..100))
random_12 = Random(Range=dom_12, Number=Slider(100, range=0..100), Seed=2)
dom_13 = ConstructDomain(DomainStart=Slider(250, range=0..1000), DomainEnd=Slider(1000, range=0..1000))
jitter_2 = Jitter(List=random_12, Jitter=Slider(1, range=0..1), Seed=2)  # -> Values, Indices
random_13 = Random(Range=dom_13, Number=Slider(100, range=0..100), Seed=2)

dom_14 = ConstructDomain(DomainStart=Slider(500, range=0..1000), DomainEnd=Slider(1000, range=0..1000))
dom_15 = ConstructDomain(DomainStart=Slider(10, range=0..100), DomainEnd=Slider(30, range=0..100))
dom_16 = ConstructDomain(DomainStart=Slider(250, range=0..1000), DomainEnd=Slider(700, range=0..1000))
random_14 = Random(Range=dom_15, Number=Slider(100, range=0..100), Seed=5)
random_15 = Random(Range=dom_14, Number=Slider(100, range=0..100), Seed=1)
random_16 = Random(Range=dom_16, Number=Slider(100, range=0..100), Seed=2)
wall_2 = CenterBox(Base=PlaneXY(0, 0, 0), X=random_15, Y=random_14, Z=random_16)

slab = CenterBox(Base=PlaneXY(0, 0, 0), X=random_11, Y=jitter.Values, Z=random_10)  # -> flatten(Box)
beam = Merge(Data1=box, Data2=box_2)  # -> flatten(Result)
column = CenterBox(Base=PlaneXY(0, 0, 0), X=random_12, Y=jitter_2.Values, Z=random_13)  # -> flatten(Box)
wall_3 = Merge(Data1=wall, Data2=wall_2)  # -> flatten(Result)
debrep = DeconstructBrep(Brep=slab)  # -> Faces, Edges, Vertices
debrep_2 = DeconstructBrep(Brep=beam)  # -> Faces, Edges, Vertices
debrep_3 = DeconstructBrep(Brep=column)  # -> Faces, Edges, Vertices
debrep_4 = DeconstructBrep(Brep=wall_3)  # -> Faces, Edges, Vertices
len = Length(Curve=debrep.Edges)
len_2 = Length(Curve=debrep_2.Edges)
len_3 = Length(Curve=debrep_3.Edges)
len_4 = Length(Curve=debrep_4.Edges)
item = ListItem(List=len, Index=[0, 1, 8], Wrap=True)
item_2 = ListItem(List=len_3, Index=[0, 1, 8], Wrap=True)
item_3 = ListItem(List=len_2, Index=[0, 1, 8], Wrap=True)
item_4 = ListItem(List=len_4, Index=[0, 1, 8], Wrap=True)
ins = InsertItems(List=item, Item="slab", Indices=Slider(3, range=0..10), Wrap=True)
ins_2 = InsertItems(List=item_3, Item="beam", Indices=Slider(3, range=0..10), Wrap=True)
ins_3 = InsertItems(List=item_2, Item="column", Indices=Slider(3, range=0..10), Wrap=True)
ins_4 = InsertItems(List=item_4, Item="wall", Indices=Slider(3, range=0..10), Wrap=True)
L = ClusterOutput(ins)
L_2 = ClusterOutput(ins_2)
L_3 = ClusterOutput(ins_3)
L_4 = ClusterOutput(ins_4)
