# Grasshopper definition PS4_classification_HandSketchRecognition.gh (Grasshopper 1.0.6)
# plug-ins: LunchBoxML

# ----
# Three possible classes:
# 1- Circle
# 2- Triangle
# 3-Square
number_slider = Slider(1, range=0..1)
# number of samples to generate
number_of_samples = Slider(200, range=0..1000)
# Is required to be a multiplier of
# class object edges so that
# there is a point at the
# vertex of the object
# 
# Circle: 1
# Triangle:3
# Square:4
# 
# Count : 12x
pt = ConstructPoint(XCoordinate=0, YCoordinate=0, ZCoordinate=0)
P = Plane(PlaneXY(0, 0, 0))
P_2 = Plane(PlaneXY(0, 0, 0))
division_count = Slider(12, range=0..100)
circle = CircleCNR(Center=pt, Normal=Vector(0, 0, 1), Radius=1)
polygon = Polygon(Plane=P, Radius=number_slider, Segments=Slider(3, range=0..10), FilletRadius=0)  # -> Polygon, Length
polygon_2 = Polygon(Plane=P_2, Radius=Slider(1, range=0..1), Segments=Slider(4, range=0..10), FilletRadius=0)  # -> Polygon, Length

# ----
# Generate synthetic data to emulate
# handdrawing precision
# prepare input data
# Range of imperfection to be induced
# -0.2 : 0.2
divide = DivideCurve(Curve=polygon.Polygon, Count=division_count, Kinks=False)  # -> Points, Tangents, Parameters
divide_2 = DivideCurve(Curve=circle, Count=division_count, Kinks=False)  # -> Points, Tangents, Parameters
divide_3 = DivideCurve(Curve=polygon_2.Polygon, Count=division_count, Kinks=False)  # -> Points, Tangents, Parameters
lng = ListLength(List=divide_2.Points)
multiplication = Multiplication(A=lng, B=number_of_samples)
dom = ConstructDomain(DomainStart=Slider(-0.2, range=-1..0), DomainEnd=Slider(0.2, range=0..1))
random = Random(Range=dom, Number=multiplication, Seed=2)
random_2 = Random(Range=dom, Number=multiplication, Seed=3)
random_3 = Random(Range=dom, Number=multiplication, Seed=3)
random_4 = Random(Range=dom, Number=multiplication, Seed=4)
random_5 = Random(Range=dom, Number=multiplication, Seed=2)
random_6 = Random(Range=dom, Number=multiplication, Seed=4)
partition = PartitionList(List=random, Size=12)
partition_2 = PartitionList(List=random_2, Size=12)
partition_3 = PartitionList(List=random_4, Size=12)
partition_4 = PartitionList(List=random_5, Size=12)
partition_5 = PartitionList(List=random_3, Size=12)
partition_6 = PartitionList(List=random_6, Size=12)
pdecon = Deconstruct(Point=divide.Points)  # -> XComponent, YComponent, ZComponent
pdecon_2 = Deconstruct(Point=divide_2.Points)  # -> XComponent, YComponent, ZComponent
pdecon_3 = Deconstruct(Point=divide_3.Points)  # -> XComponent, YComponent, ZComponent
addition = Addition(A=pdecon_2.XComponent, B=partition)
addition_2 = Addition(A=pdecon_2.YComponent, B=partition_2)
addition_3 = Addition(A=partition_5, B=pdecon_3.XComponent)
addition_4 = Addition(A=partition_3, B=pdecon.XComponent)
addition_5 = Addition(A=partition_4, B=pdecon.YComponent)
addition_6 = Addition(A=partition_6, B=pdecon_3.YComponent)
pt_2 = ConstructPoint(XCoordinate=addition, YCoordinate=addition_2, ZCoordinate=0)  # -> simplify(Point)
pt_3 = ConstructPoint(XCoordinate=addition_4, YCoordinate=addition_5, ZCoordinate=0)  # -> simplify(Point)
pt_4 = ConstructPoint(XCoordinate=addition_3, YCoordinate=addition_6, ZCoordinate=0)  # -> simplify(Point)
pline = PolyLine(Vertices=pt_2, Closed=True)
pline_2 = PolyLine(Vertices=pt_3, Closed=True)
pline_3 = PolyLine(Vertices=pt_4, Closed=True)
lng_2 = ListLength(List=flatten(pline_3))
lng_3 = ListLength(List=flatten(pline_2))
lng_4 = ListLength(List=flatten(pline))
path_mapper = PathMapper(pt_2, source="{a}", target="{0;a}")
path_mapper_2 = PathMapper(pt_4, source="{a}", target="{2;a}")
path_mapper_3 = PathMapper(pt_3, source="{a}", target="{1;a}")
repeat = RepeatData(Data=0, Length=lng_4)  # -> simplify(Data)
repeat_2 = RepeatData(Data=1, Length=lng_3)  # -> simplify(Data)
repeat_3 = RepeatData(Data=2, Length=lng_2)  # -> simplify(Data)
merge = Merge(Data1=repeat, Data2=repeat_2, Data3=repeat_3)
pt_5 = Point([path_mapper, path_mapper_3, path_mapper_2])

# ----
# Prepare test data
# regularize
crv = Curve(<curve referenced from the Rhino model>)
divide_4 = DivideCurve(Curve=crv, Count=12, Kinks=False)  # -> Points, Tangents, Parameters
pdecon_4 = Deconstruct(Point=divide_4.Points)  # -> XComponent, YComponent, ZComponent
bnd = Bounds(Numbers=pdecon_4.XComponent)
bnd_2 = Bounds(Numbers=pdecon_4.YComponent)
remap = RemapNumbers(Value=pdecon_4.XComponent, Source=bnd, Target=Domain(-1, 1))  # -> Mapped, Clipped
remap_2 = RemapNumbers(Value=pdecon_4.YComponent, Source=bnd_2, Target=Domain(-1, 1))  # -> Mapped, Clipped
pt_6 = ConstructPoint(XCoordinate=remap.Mapped, YCoordinate=remap_2.Mapped, ZCoordinate=0)

# ----
# Visualize training data
number_slider_2 = Slider(377, range=0..1000)
panel = Panel(pt_5)
pline_4 = PolyLine(Vertices=pt_5, Closed=True)
item = ListItem(List=flatten(pline_4), Index=number_slider_2, Wrap=True)
item_2 = ListItem(List=flatten(merge), Index=number_slider_2, Wrap=True)
eval = Evaluate(F="if(x=0,y,if(x=1,z,u))", x=item_2, y="circle", z="triangle", u="square")
panel_2 = Panel(eval)

neural = NeuralNetwork(TestData=pt_6, TraingInputs=pt_5, Labels=merge, HiddenNeurons=5, Alpha=2, Iterations=10, RandomSeed=5)

# ----
# Process test data for visualization
area = Area(Geometry=crv)  # -> Area, Centroid
dist = Distance(PointA=area.Centroid, PointB=divide_4.Points)
sort = SortList(Keys=dist, ValuesA=divide_4.Points)  # -> Keys, ValuesA
item_3 = ListItem(List=sort.Keys, Index=0, Wrap=True)
item_4 = ListItem(List=reverse(sort.ValuesA), Index=0, Wrap=True)
vec2pt = Vector2Pt(PointA=area.Centroid, PointB=item_4, Unitize=False)  # -> Vector, Length
X = UnitX(Factor=1)
angle = Angle(VectorA=X, VectorB=vec2pt.Vector)  # -> Angle, Reflex

p_n_c = PickNChoose(Pattern=neural, Stream0="circle", Stream1="triangle", Stream2="square")
panel_3 = Panel(p_n_c)

polygon_3 = Polygon(Plane=area.Centroid, Radius=expr("x*2", item_3), Segments=3, FilletRadius=0)  # -> Polygon, Length
eval_2 = Evaluate(F="x*sqrt(3/2)", x=item_3)
Z = UnitZ(Factor=eval_2)
rotate = Rotate(Geometry=polygon_3.Polygon, Angle=angle.Reflex, Plane=area.Centroid)  # -> Geometry, Transform
move = Move(Geometry=area.Centroid, Motion=Z)  # -> Geometry, Transform
extr = ExtrudePoint(Base=rotate.Geometry, Point=move.Geometry)

box = CenterBox(Base=area.Centroid, X=item_3, Y=item_3, Z=item_3)
rotate_2 = Rotate(Geometry=box, Angle=expr("x+pi/4", angle.Reflex), Plane=area.Centroid)  # -> Geometry, Transform

# ----
# Prepare 3D geometry for classes
sph = Sphere(Base=area.Centroid, Radius=item_3)

# ----
# Place 3D geometry to the proper place
X_2 = UnitX(Factor=item_4)
move_2 = Move(Geometry=area.Centroid, Motion=X_2)  # -> Geometry, Transform
p_n_c_2 = PickNChoose(Pattern=neural, Stream0=sph, Stream1=extr, Stream2=rotate_2.Geometry)
tag = TextTag3D(Location=move_2.Geometry, Text=panel_3, Size=item_3, Justification=7)
