# Grasshopper definition data.gh (Grasshopper 1.0.7)
# plug-ins: LunchBoxML, Dodo

testset = TestSet()  # -> brep_5, brep_6, R, brep_7, brep_8
trainingset = TrainingSet()  # -> L_3, L_2, L_4, L
archelements = Merge(Data1=trainingset.L_3, Data2=trainingset.L_2, Data3=trainingset.L_4, Data4=trainingset.L)  # -> flatten(Result)
merge = Merge(Data1=testset.brep_5, Data2=testset.brep_6, Data3=testset.brep_7, Data4=testset.brep_8)
lng = ListLength(List=merge)
partition = PartitionList(List=archelements, Size=4)
partition_2 = PartitionList(List=testset.R, Size=lng)
flip = FlipMatrix(Data=partition_2)
data = Data(simplify(partition))
data_2 = Data(simplify(flip))
split = SplitList(List=data, Index=3)  # -> simplify(ListA), ListB
split_2 = SplitList(List=data_2, Index=3)  # -> ListA, ListB
flip_2 = FlipMatrix(Data=split.ListA)
eval = Evaluate(F="if(x = \"column\",1,if(x=\"beam\",2,if(x=\"wall\",3,if(x=\"slab\",4,0))))", x=split.ListB)  # -> flatten(r)
bnd = Bounds(Numbers=flip_2)
suptrainnn = SupervisedTrainingNN(D=split.ListA, O=eval)
path_mapper = PathMapper(split.ListA, source="{a}", target="{0;a}")
random = Random(Range=bnd, Number=3, Seed=2)
random_2 = Random(Range=bnd, Number=1, Seed=4)
random_3 = Random(Range=bnd, Number=1, Seed=7)
panel = Panel(split.ListA)
panel_2 = Panel(path_mapper)
runnn = RunNeuralNetwork(NeuralNetwork=suptrainnn, Data=panel_2)  # -> Data, Weights, Threshold
neural = NeuralNetwork(HiddenNeurons=5, Alpha=2, Iterations=10, RandomSeed=5)
neural_2 = NeuralNetwork(HiddenNeurons=5, Alpha=2, Iterations=10, RandomSeed=5)
logreg = LogisticRegression(
    TestData=random,
    TrainingInputs=path_mapper,
    TrainingOutput=eval,
    Tolerance=0.0001,
    MaximumIterations=100,
    RegularizationValue=0,
    RandomSeed=5)  # -> Result, Score

# ==== cluster TrainingSet

dom = ConstructDomain(DomainStart=Slider(40, range=0..100), DomainEnd=Slider(80, range=0..1000))
dom_2 = ConstructDomain(DomainStart=Slider(250, range=0..1000), DomainEnd=Slider(1000, range=0..1000))
dom_3 = ConstructDomain(DomainStart=Slider(20, range=0..100), DomainEnd=Slider(50, range=0..100))
random = Random(Range=dom_3, Number=Slider(100, range=0..100), Seed=Slider(5, range=0..10))
random_2 = Random(Range=dom_2, Number=Slider(100, range=0..100), Seed=2)
random_3 = Random(Range=dom, Number=Slider(100, range=0..100), Seed=2)
box = CenterBox(Base=PlaneXY(0, 0, 0), X=random, Y=random_2, Z=random_3)

dom_4 = ConstructDomain(DomainStart=Slider(40, range=0..100), DomainEnd=Slider(80, range=0..1000))
dom_5 = ConstructDomain(DomainStart=Slider(250, range=0..1000), DomainEnd=Slider(1000, range=0..1000))
dom_6 = ConstructDomain(DomainStart=Slider(20, range=0..100), DomainEnd=Slider(50, range=0..100))
random_4 = Random(Range=dom_6, Number=Slider(100, range=0..100), Seed=Slider(5, range=0..10))
random_5 = Random(Range=dom_5, Number=Slider(100, range=0..100), Seed=2)
random_6 = Random(Range=dom_4, Number=Slider(100, range=0..100), Seed=2)
box_2 = CenterBox(Base=PlaneXY(0, 0, 0), X=random_5, Y=random_4, Z=random_6)

dom_7 = ConstructDomain(DomainStart=Slider(500, range=0..1000), DomainEnd=Slider(1000, range=0..1000))
dom_8 = ConstructDomain(DomainStart=Slider(10, range=0..100), DomainEnd=Slider(30, range=0..100))
dom_9 = ConstructDomain(DomainStart=Slider(250, range=0..1000), DomainEnd=Slider(600, range=0..1000))
random_7 = Random(Range=dom_8, Number=Slider(100, range=0..100), Seed=5)
random_8 = Random(Range=dom_7, Number=Slider(100, range=0..100), Seed=1)
random_9 = Random(Range=dom_9, Number=Slider(100, range=0..100), Seed=2)
wall = CenterBox(Base=PlaneXY(0, 0, 0), X=random_7, Y=random_8, Z=random_9)

dom_10 = ConstructDomain(DomainStart=Slider(10, range=0..100), DomainEnd=Slider(30, range=0..100))
random_10 = Random(Range=dom_10, Number=Slider(100, range=0..100), Seed=2)
dom_11 = ConstructDomain(DomainStart=Slider(250, range=0..1000), DomainEnd=Slider(1000, range=0..1000))
random_11 = Random(Range=dom_11, Number=Slider(100, range=0..100), Seed=5)
jitter = Jitter(List=random_11, Jitter=Slider(1, range=0..1), Seed=2)  # -> Values, Indices

dom_12 = ConstructDomain(DomainStart=Slider(20, range=0..100), DomainEnd=Slider(50, range=0..100))
random_12 = Random(Range=dom_12, Number=Slider(100, range=0..100), Seed=2)
dom_13 = ConstructDomain(DomainStart=Slider(250, range=0..1000), DomainEnd=Slider(1000, range=0..1000))
jitter_2 = Jitter(List=random_12, Jitter=Slider(1, range=0..1), Seed=2)  # -> Values, Indices
random_13 = Random(Range=dom_13, Number=Slider(100, range=0..100), Seed=2)

dom_14 = ConstructDomain(DomainStart=Slider(500, range=0..1000), DomainEnd=Slider(1000, range=0..1000))
dom_15 = ConstructDomain(DomainStart=Slider(10, range=0..100), DomainEnd=Slider(30, range=0..100))
dom_16 = ConstructDomain(DomainStart=Slider(250, range=0..1000), DomainEnd=Slider(700, range=0..1000))
random_14 = Random(Range=dom_15, Number=Slider(100, range=0..100), Seed=5)
random_15 = Random(Range=dom_14, Number=Slider(100, range=0..100), Seed=1)
random_16 = Random(Range=dom_16, Number=Slider(100, range=0..100), Seed=2)
wall_2 = CenterBox(Base=PlaneXY(0, 0, 0), X=random_15, Y=random_14, Z=random_16)

slab = CenterBox(Base=PlaneXY(0, 0, 0), X=random_11, Y=jitter.Values, Z=random_10)  # -> flatten(Box)
beam = Merge(Data1=box, Data2=box_2)  # -> flatten(Result)
column = CenterBox(Base=PlaneXY(0, 0, 0), X=random_12, Y=jitter_2.Values, Z=random_13)  # -> flatten(Box)
wall_3 = Merge(Data1=wall, Data2=wall_2)  # -> flatten(Result)
debrep = DeconstructBrep(Brep=slab)  # -> Faces, Edges, Vertices
debrep_2 = DeconstructBrep(Brep=beam)  # -> Faces, Edges, Vertices
debrep_3 = DeconstructBrep(Brep=column)  # -> Faces, Edges, Vertices
debrep_4 = DeconstructBrep(Brep=wall_3)  # -> Faces, Edges, Vertices
len = Length(Curve=debrep.Edges)
len_2 = Length(Curve=debrep_2.Edges)
len_3 = Length(Curve=debrep_3.Edges)
len_4 = Length(Curve=debrep_4.Edges)
item = ListItem(List=len, Index=[0, 1, 8], Wrap=True)
item_2 = ListItem(List=len_3, Index=[0, 1, 8], Wrap=True)
item_3 = ListItem(List=len_2, Index=[0, 1, 8], Wrap=True)
item_4 = ListItem(List=len_4, Index=[0, 1, 8], Wrap=True)
ins = InsertItems(List=item, Item="slab", Indices=Slider(3, range=0..10), Wrap=True)
ins_2 = InsertItems(List=item_3, Item="beam", Indices=Slider(3, range=0..10), Wrap=True)
ins_3 = InsertItems(List=item_2, Item="column", Indices=Slider(3, range=0..10), Wrap=True)
ins_4 = InsertItems(List=item_4, Item="wall", Indices=Slider(3, range=0..10), Wrap=True)
L = ClusterOutput(ins)
L_2 = ClusterOutput(ins_2)
L_3 = ClusterOutput(ins_3)
L_4 = ClusterOutput(ins_4)

# ==== cluster TestSet
brep = Brep([<brep referenced from the Rhino model> x913])
brep_2 = Brep([<brep referenced from the Rhino model> x1685])
brep_3 = Brep([<brep referenced from the Rhino model> x330])
brep_4 = Brep([<brep referenced from the Rhino model> x83])
brep_5 = ClusterOutput(brep)
brep_6 = ClusterOutput(brep_2)
brep_7 = ClusterOutput(brep_3)
brep_8 = ClusterOutput(brep_4)
bbox = BoundingBox(Content=brep_2, Plane=PlaneXY(0, 0, 0))  # -> Box, Box_2
bbox_2 = BoundingBox(Content=brep_4, Plane=PlaneXY(0, 0, 0))  # -> Box, Box_2
bbox_3 = BoundingBox(Content=brep, Plane=PlaneXY(0, 0, 0))  # -> Box, Box_2
bbox_4 = BoundingBox(Content=brep_3, Plane=PlaneXY(0, 0, 0))  # -> Box, Box_2
debox = DeconstructBox(Box=bbox.Box)  # -> Plane, X, Y, Z
debox_2 = DeconstructBox(Box=bbox_2.Box)  # -> Plane, X, Y, Z
debox_3 = DeconstructBox(Box=bbox_3.Box)  # -> Plane, X, Y, Z
debox_4 = DeconstructBox(Box=bbox_4.Box)  # -> Plane, X, Y, Z
dedomain = DeconstructDomain(Domain=debox.X)  # -> Start, End
dedomain_2 = DeconstructDomain(Domain=debox_2.X)  # -> Start, End
dedomain_3 = DeconstructDomain(Domain=debox_3.X)  # -> Start, End
dedomain_4 = DeconstructDomain(Domain=debox.Z)  # -> Start, End
dedomain_5 = DeconstructDomain(Domain=debox_2.Z)  # -> Start, End
dedomain_6 = DeconstructDomain(Domain=debox.Y)  # -> Start, End
dedomain_7 = DeconstructDomain(Domain=debox_2.Y)  # -> Start, End
dedomain_8 = DeconstructDomain(Domain=debox_3.Z)  # -> Start, End
dedomain_9 = DeconstructDomain(Domain=debox_3.Y)  # -> Start, End
dedomain_10 = DeconstructDomain(Domain=debox_4.X)  # -> Start, End
dedomain_11 = DeconstructDomain(Domain=debox_4.Z)  # -> Start, End
dedomain_12 = DeconstructDomain(Domain=debox_4.Y)  # -> Start, End
subtraction = Subtraction(A=dedomain_4.End, B=dedomain_4.Start)  # -> simplify(graft(Result))
subtraction_2 = Subtraction(A=dedomain_5.End, B=dedomain_5.Start)  # -> simplify(graft(Result))
subtraction_3 = Subtraction(A=dedomain_6.End, B=dedomain_6.Start)  # -> simplify(graft(Result))
subtraction_4 = Subtraction(A=dedomain_7.End, B=dedomain_7.Start)  # -> simplify(graft(Result))
subtraction_5 = Subtraction(A=dedomain.End, B=dedomain.Start)  # -> simplify(graft(Result))
subtraction_6 = Subtraction(A=dedomain_2.End, B=dedomain_2.Start)  # -> simplify(graft(Result))
subtraction_7 = Subtraction(A=dedomain_8.End, B=dedomain_8.Start)  # -> simplify(graft(Result))
subtraction_8 = Subtraction(A=dedomain_9.End, B=dedomain_9.Start)  # -> simplify(graft(Result))
subtraction_9 = Subtraction(A=dedomain_3.End, B=dedomain_3.Start)  # -> simplify(graft(Result))
subtraction_10 = Subtraction(A=dedomain_11.End, B=dedomain_11.Start)  # -> simplify(graft(Result))
subtraction_11 = Subtraction(A=dedomain_12.End, B=dedomain_12.Start)  # -> simplify(graft(Result))
subtraction_12 = Subtraction(A=dedomain_10.End, B=dedomain_10.Start)  # -> simplify(graft(Result))
merge = Merge(Data1=subtraction_5, Data2=subtraction_3, Data3=subtraction)
merge_2 = Merge(Data1=subtraction_6, Data2=subtraction_4, Data3=subtraction_2)
merge_3 = Merge(Data1=subtraction_9, Data2=subtraction_8, Data3=subtraction_7)
merge_4 = Merge(Data1=subtraction_12, Data2=subtraction_11, Data3=subtraction_10)
ins = InsertItems(List=merge_3, Item=graft("column"), Indices=3, Wrap=True)  # -> simplify(List)
ins_2 = InsertItems(List=merge_2, Item=graft("slab"), Indices=3, Wrap=True)  # -> simplify(List)
ins_3 = InsertItems(List=merge, Item=graft("beam"), Indices=3, Wrap=True)  # -> simplify(List)
ins_4 = InsertItems(List=merge_4, Item=graft("wall"), Indices=3, Wrap=True)  # -> simplify(List)
flip = FlipMatrix(Data=ins)
flip_2 = FlipMatrix(Data=ins_3)
flip_3 = FlipMatrix(Data=ins_4)
flip_4 = FlipMatrix(Data=ins_2)
merge_5 = Merge(Data1=flip, Data2=flip_2, Data3=flip_3, Data4=flip_4)  # -> flatten(Result)
R = ClusterOutput(merge_5)
