# Grasshopper definition ps_clustering.gh (Grasshopper 1.0.4)
# plug-ins: LunchBoxML

box = CenterBox(Base=PlaneXY(0, 0, 0), X=Slider(100, range=0..100), Y=Slider(150, range=0..1000), Z=Slider(450, range=0..1000))
pop3d = Populate3D(Region=box, Count=Slider(250, range=0..1000), Seed=1)
pdecon = Deconstruct(Point=pop3d)  # -> XComponent, YComponent, ZComponent
entwine = Entwine(Branch00=pdecon.XComponent, Branch01=pdecon.YComponent, Branch02=pdecon.ZComponent, FlattenInputs=True)
number_slider = Slider(4, range=0..10)
flip = FlipMatrix(Data=entwine)
k_means = KMeansClustering(TrainingInputs=flip, OfClusters=number_slider, RandomSeed=5)  # -> Result, Likelihood, Centroids
gaussianmix = GaussianMixture(TrainingInputs=flip, Components=number_slider, RandomSeed=5)  # -> Result, Likelihood, Probability
series = Series(Start=0, Step=1, Count=number_slider)
bnd = Bounds(Numbers=series)
remap = RemapNumbers(Value=series, Source=bnd, Target=Domain(0, 0.8))  # -> Mapped, Clipped
equals = Equality(FirstNumber=gaussianmix.Result, SecondNumber=graft(series))  # -> Equality, Inequality
hsv = ColourHSV(Alpha=1, Hue=remap.Mapped, Saturation=0.5, Value=1)
cull = CullPattern(List=pop3d, CullPattern=equals.Equality)
prox = Proximity3D(Points=cull, Group=5)  # -> simplify(Links), Topology
path_mapper = PathMapper(prox.Links, source="{a;b}", target="{a}")
preview = CustomPreview(Geometry=path_mapper, Material=graft(hsv))
