# Grasshopper definition ps_dataAugmentation.gh (Grasshopper 1.0.4)
# plug-ins: LunchBoxML

pt = ConstructPoint(XCoordinate=0, YCoordinate=0, ZCoordinate=0)
P = Plane(PlaneXY(0, 0, 0))
P_2 = Plane(PlaneXY(0, 0, 0))
number_slider = Slider(12, range=0..100)
circle = CircleCNR(Center=pt, Normal=Vector(0, 0, 1), Radius=1)
polygon = Polygon(Plane=P, Radius=Slider(1, range=0..1), Segments=Slider(3, range=0..10), FilletRadius=0)  # -> Polygon, Length
polygon_2 = Polygon(Plane=P_2, Radius=Slider(1, range=0..1), Segments=Slider(4, range=0..10), FilletRadius=0)  # -> Polygon, Length
divide = DivideCurve(Curve=polygon.Polygon, Count=number_slider, Kinks=False)  # -> Points, Tangents, Parameters
divide_2 = DivideCurve(Curve=circle, Count=number_slider, Kinks=False)  # -> Points, Tangents, Parameters
divide_3 = DivideCurve(Curve=polygon_2.Polygon, Count=number_slider, Kinks=False)  # -> Points, Tangents, Parameters
lng = ListLength(List=divide_2.Points)
multiplication = Multiplication(A=lng, B=Slider(200, range=0..1000))
dom = ConstructDomain(DomainStart=Slider(-0.2, range=-1..0), DomainEnd=Slider(0.2, range=0..1))
random = Random(Range=dom, Number=multiplication, Seed=2)
random_2 = Random(Range=dom, Number=multiplication, Seed=3)
random_3 = Random(Range=dom, Number=multiplication, Seed=3)
random_4 = Random(Range=dom, Number=multiplication, Seed=4)
random_5 = Random(Range=dom, Number=multiplication, Seed=2)
random_6 = Random(Range=dom, Number=multiplication, Seed=4)
partition = PartitionList(List=random, Size=12)
partition_2 = PartitionList(List=random_2, Size=12)
partition_3 = PartitionList(List=random_4, Size=12)
partition_4 = PartitionList(List=random_5, Size=12)
partition_5 = PartitionList(List=random_3, Size=12)
partition_6 = PartitionList(List=random_6, Size=12)
pdecon = Deconstruct(Point=divide.Points)  # -> XComponent, YComponent, ZComponent
pdecon_2 = Deconstruct(Point=divide_2.Points)  # -> XComponent, YComponent, ZComponent
pdecon_3 = Deconstruct(Point=divide_3.Points)  # -> XComponent, YComponent, ZComponent
addition = Addition(A=pdecon_2.XComponent, B=partition)
addition_2 = Addition(A=pdecon_2.YComponent, B=partition_2)
addition_3 = Addition(A=partition_5, B=pdecon_3.XComponent)
addition_4 = Addition(A=partition_3, B=pdecon.XComponent)
addition_5 = Addition(A=partition_4, B=pdecon.YComponent)
addition_6 = Addition(A=partition_6, B=pdecon_3.YComponent)
pt_2 = ConstructPoint(XCoordinate=addition, YCoordinate=addition_2, ZCoordinate=0)  # -> simplify(Point)
pt_3 = ConstructPoint(XCoordinate=addition_4, YCoordinate=addition_5, ZCoordinate=0)  # -> simplify(Point)
pt_4 = ConstructPoint(XCoordinate=addition_3, YCoordinate=addition_6, ZCoordinate=0)  # -> simplify(Point)
pline = PolyLine(Vertices=pt_2, Closed=True)
lng_2 = ListLength(List=flatten(pline))
repeat = RepeatData(Data=0, Length=lng_2)  # -> simplify(Data)
pline_2 = PolyLine(Vertices=pt_3, Closed=True)
lng_3 = ListLength(List=flatten(pline_2))
pline_3 = PolyLine(Vertices=pt_4, Closed=True)
lng_4 = ListLength(List=flatten(pline_3))
repeat_2 = RepeatData(Data=2, Length=lng_4)  # -> simplify(Data)
repeat_3 = RepeatData(Data=1, Length=lng_3)  # -> simplify(Data)
path_mapper = PathMapper(pt_2, source="{a}", target="{0;a}")
path_mapper_2 = PathMapper(pt_3, source="{a}", target="{1;a}")
crv = Curve(<curve referenced from the Rhino model>)
path_mapper_3 = PathMapper(pt_4, source="{a}", target="{2;a}")
divide_4 = DivideCurve(Curve=crv, Count=12, Kinks=False)  # -> Points, Tangents, Parameters
merge = Merge(Data1=repeat, Data2=repeat_3, Data3=repeat_2)
pt_5 = Point([path_mapper, path_mapper_2, path_mapper_3])
neural = NeuralNetwork(TestData=divide_4.Points, TraingInputs=pt_5, Labels=merge, HiddenNeurons=5, Alpha=2, Iterations=10, RandomSeed=5)
